# Dynamo graph Unhide_Element_From_Views.dyn (Dynamo 2.6.1.8786)
# packages: archi-lab.net 2022.212.2821

views = Views()  # nothing selected
categories = Categories("OST_Conduit")
all_elements_of_category = ElementsOfCategory(Category=categories)
string = StringInput("Mark")
getParameterValueByName = Element.GetParameterValueByName(element=all_elements_of_category, parameterName=string)
string_2 = StringInput("E66")
eq = getParameterValueByName == string_2
filterByBoolMask = List.FilterByBoolMask(list=all_elements_of_category, mask=eq)
unHideElements = archilab.Revit.Views.Views.UnHideElements(view=views, elements=filterByBoolMask.in)
categories_2 = Categories("OST_ConduitFitting")
all_elements_of_category_2 = ElementsOfCategory(Category=categories_2)
getParameterValueByName_2 = Element.GetParameterValueByName(element=all_elements_of_category_2, parameterName=string)
eq_2 = getParameterValueByName_2 == string_2
filterByBoolMask_2 = List.FilterByBoolMask(list=all_elements_of_category_2, mask=eq_2)
unHideElements_2 = archilab.Revit.Views.Views.UnHideElements(view=views, elements=filterByBoolMask_2.in)
